# Dynamo graph codice-7-1-dynamo.dyn "cap-7-2-dynamo" (Dynamo 2.13.1.3887)
# Grafo del capitolo 7.2 (lunghezza del circuito): selezione del percorso, somma delle lunghezze 3D e sfrido.

select_model_elements = DSModelElementsSelection()  # nothing selected
code_block = CodeBlock { "Length"; }
getParameterValueByName = Element.GetParameterValueByName(element=select_model_elements, parameterName=code_block)
python_script = Python(IN[0]=getParameterValueByName)  # CPython3
# ---------- python_script.python (12 lines) ----------
# Cap. 7.2 - Lunghezza reale del cavo
# IN[0] = lunghezze dei tratti (parametro "Length", in metri)
vals = IN[0]
if not isinstance(vals, list):
    vals = [vals]

# somma solo i tratti con una lunghezza: i raccordi danno None
L_mod = sum(v for v in vals if v is not None)

L_cavo = L_mod * 1.05        # + 5% di sfrido (posa)

OUT = round(L_cavo, 2)
# ----------------------------------------
watch = Watch(python_script)
