# Dynamo graph codice-7-2-dynamo.dyn "cap-7-2-dynamo" (Dynamo 2.13.1.3887)
# Grafo del capitolo 7.2 (lunghezza del circuito): lettura del percorso, collegamenti verticali e sfrido.

select_model_element = DSModelElementSelection()  # nothing selected
code_block = CodeBlock { "Length"; }
getParameterValueByName = Element.GetParameterValueByName(element=select_model_element, parameterName=code_block)
python_script = Python(IN[0]=getParameterValueByName)  # CPython3
# ---------- python_script.python (16 lines) ----------
# Cap. 7.2 - Lunghezza reale del cavo
# IN[0] = lunghezza del percorso modellato, letta dal modello (m)
L_orizz = IN[0]
if isinstance(L_orizz, list):
    L_orizz = sum(L_orizz)

# quote di progetto (m)
z_pass   = 4.1     # quota della passerella (dal modello)
z_quadro = 3.2     # uscita del cavo in cima al quadro QE-01
z_carico = 1.0     # morsettiera del motore M-12

L_vert = (z_pass - z_quadro) + (z_pass - z_carico)   # risalita + discesa
L_geom = L_orizz + L_vert                            # lunghezza geometrica
L_cavo = L_geom * 1.05                               # + 5% di sfrido (posa)

OUT = round(L_cavo, 2)
# ----------------------------------------
watch = Watch(python_script)
