# Dynamo graph codice-7-3-dynamo.dyn "cap-7-3-dynamo" (Dynamo 2.13.1.3887)
# Grafo del capitolo 7.3 (riempimento dei cavidotti): diametro interno, aree dei cavi e verifica CEI 64-8.

select_model_element = DSModelElementSelection()  # nothing selected
code_block = CodeBlock { "Inside Diameter"; }
getParameterValueByName = Element.GetParameterValueByName(element=select_model_element, parameterName=code_block)
python_script = Python(IN[0]=getParameterValueByName)  # CPython3
# ---------- python_script.python (20 lines) ----------
# Cap. 7.3 - Riempimento del cavidotto
import math

# IN[0] = diametro interno del tubo ("Inside Diameter", mm)
De = IN[0]
if isinstance(De, list):
    De = De[0]

# i cavi del circuito: (nome, diametro esterno mm, quantita')
cavi = [("FG16OR16 3G2.5", 11.5, 2), ("N07V-K 1x4", 4.4, 3)]

A_tubo = math.pi / 4.0 * De ** 2
A_cavi = sum(math.pi / 4.0 * d ** 2 * q for _, d, q in cavi)
K = A_cavi / A_tubo                    # riempimento (0..1)

Dt = math.sqrt(sum(d ** 2 * q for _, d, q in cavi))   # fascio
conforme = De >= 1.3 * Dt              # CEI 64-8

OUT = "{:.1f} % - {}".format(
    K * 100, "CONFORME" if conforme else "NON CONFORME")
# ----------------------------------------
watch = Watch(python_script)
